vi "Gather Signals for Saving.gvi"   [LabVIEW Communications System Design Software 2.0.1]
inputs:
  "Local Interests": "Local Interests.gtype"
  "power spectrum current": T1
outputs:
  "f0": f64[][]
  "signals2D": f64[][]
  "Trigger Save?": bool
  "df": f64
types:
  "Local Interests.gtype" = cluster{"Indices": u32[], "Frequencies": f64[], "Indices in sub-band?": bool}
  T1 = cluster{"f0": f64, "df": f64, "spectrum in dB": f64[]}
diagram:
  Property Node(instance in=$"Local Interests") -> ("Indices"=w1, "Frequencies"=w2, "Indices in sub-band?"=w3)
  Property Node(instance in=$"power spectrum current") -> ("df"=w4, "spectrum in dB"=w5)
  Math Node("df"=w4, "ind"=w1, "IQ_current"=w5, "freq"=w2, "indices_in_subband"=w3) -> ("signals2D"=w6, "f0"=w7)
  ~~~
  B = 100000/df;
  L_ind = length(ind);
  L_IQ = length(IQ_current);
  signals2D = zeros(L_ind, 2*B+1);
  f0 = zeros(L_ind,1);
  if indices_in_subband
      for ii = 1:L_ind
          if ind(ii) - B < 0 || ind(ii) + B > L_IQ
              %error
          else
              signals2D(ii,:) = IQ_current(ind(ii) - B : ind(ii) + B);
              f0(ii) = freq(ii) - B*df;
          end
      end
  end
  ~~~
  $signals2D <- w6
  # signals2D:
  # 	Each row is a different signal that peaked above threshold
  # f0:
  # 	Beginning frequency of signal
  # Trigger Save?:
  # 	Boolean indicating whether to save this data
  # df:
  # 	Common df for the recorded signals
  $f0 <- w7
  $"Trigger Save?" <- w3
  # Note, signals2D is not the consecutive recordings.
  # There will be #numberavergages of these signals2D
  # by the end of the inner while loop.
  $df <- w4
