vi "Read From File.gvi"   [LabVIEW Communications System Design Software 2.0.1]
panel controls:
  "file path": path
panel indicators:
  "loop iteration": i32
  "data": waveform<f64>[]
  "group/channel names": string[][]
  "property values": variant[]
  "property names": string[]
diagram:
  TDMS Open(file path=$"file path", operation="open (read-only)") -> (tdms file out=w1)
  while (iteration -> i1) {
    TDMS Get Properties(tdms file=w1) -> (property names=w2, property values=w3)
    $"property values" <- w3
    $"property names" <- w2
    TDMS List Contents(tdms file=w1) -> (group/channel names=w4)
    $"group/channel names" <- w4
    Wait(time to wait=2)
    TDMS Read(count=21, offset=i1, return channels in file order=TRUE, tdms file=w1) -> (data=w5, end of file?=w6, tdms file out=w7)
    $data <- w5
    $"loop iteration" <- i1
    stop if w6
  }
  TDMS Close(tdms file=w7)
