vi "Spectrum Monitor (no saving).gvi"   [LabVIEW Communications System Design Software 2.0.1]
outputs:
  "LO Frequency": f64
  "Spectrum Size": i32
  "Frame Parameters Out": T5
panel controls:
  "RX Parameters In": T1 = {"IQ Sampling Rate [S/sec]"=20000000, "Gain [dB]"=0, "Reference Frequency"="Internal", "Timebase Clock Source"="Internal", "Start Carrier [Hz]"=95000000, "Stop Carrier [Hz]"=105000000, "Acq Duration [sec]"=0.0001, "Active Antenna"="RX2"}
  "Device Names": "niUSRPClass" = "192.168.10.2"
  "Averaging Parameters": "Averaging Parameters.gtype" = {"averaging mode"="RMS averaging", "weighting mode"="Linear", "number of averages"=4}  # averaging parameters defines how the averaging is computed. The specifications of the parameters include the type of averaging, the type of weighting, and the number of averages.
  "Display": T4 = {"display unit"="Vrms", "dB type"="dB"}
  "Stop Capture": bool
  "Tab": i32
  "threshold": f64 = -40
  "IQ frac": enum{"0.25", "0.5", "0.6", "0.8"} = "0.25"
  "Waterfall Histpry Length": i32 = 5
panel indicators:
  "error out": error
  "Samples per Acquisition": i64
  "Carrier Freq Out": f64
  "FFT Power Spectrum": cluster{"f0": f64, "df": f64, "IQ": f64[]}
  "Carrier List": f64[]
  "Power Detection": "Power Detection cluster.gtype"
  "Waterfall Plot": f64[][]
types:
  T1 = cluster{"IQ Sampling Rate [S/sec]": f64, "Gain [dB]": f64, "Reference Frequency": string, "Timebase Clock Source": string, "Start Carrier [Hz]": f64, "Stop Carrier [Hz]": f64, "Acq Duration [sec]": f64, "Active Antenna": string}
  T2 = enum{"No averaging", "Vector averaging", "RMS averaging", "Peak hold"}
  "Averaging Parameters.gtype" = cluster{"averaging mode": T2, "weighting mode": enum{"Linear", "Exponential"}, "number of averages": u32}
  T3 = enum{"Vrms", "Vpk", "Vrms^2", "Vpk^2", "Vrms/rtHz", "Vpk/rtHz", "Vrms^2/Hz", "Vpk^2/Hz"}
  T4 = cluster{"display unit": T3, "dB type": enum{"Linear", "dB", "dBm"}}
  T5 = cluster{"IQ Rate": f64, "Frames": i32, "Length of Subset": i32, "Start Carrier [Hz": f64, "Stop Carrier [Hz]": f64, "Acq Duration [Sec]": f64, "Start Index of Subset": i32}
  "Power Detection cluster.gtype" = cluster{"Estimated Freqs. above Threshold": f64[], "Power at those Freqs.": f64[], "Num. peaks detected": i32, "Num. in queue": i32}
diagram:
  call "niUSRP Open Rx Session.gvi"(niUSRP Device=$"Device Names") -> (error out=w1, session handle out=w2)
  call "Set Parameters.gvi"(RX Parameters In=$"RX Parameters In", USRP Session Handle In=w2, error in (no error)=w1, IQ frac=$"IQ frac") -> (error out: HW RX Param subsetup=w3, USRP Session Handle Out=w4, Test Carrier Frequencies=w5, Samples per Acquisition=w6, Frame Parameters Out=w7, IQ frac out=w8)
  Property Node(instance in=$"Averaging Parameters") -> ("number of averages"=w9, instance out=w10)
  call "niUSRP Configure Number of Samples.gvi"(session handle=w4, number of samples is finite=TRUE, number of samples=w6, error in (no error)=w3) -> (session handle out=w11, Error Out=w12)
  To Long Integer(number=w9) -> w13
  w14 = $Display
  w15 = $"Waterfall Histpry Length"
  w16 = $threshold
  # Testing Spectrum Monitor. Not as many indicators will
  # be on panel in final version.
  while {
    # Go back to the first carrier frequency and repeat
    s1 = 0  # shift register
    for (iteration -> i1) (after w8) {
      w17 = each element of w5
      call "Set Carrier and LO_2.gvi"(Current Frequency=w17, niusrp in_2=w11, error in=w12) -> (Error=w18, Usrp.niUSRPClass=w19)
      # Get new carrier frequency
      for (N = w13) (iteration -> i2) {
        # Averaging Loop
        call "Read Data.gvi"(USRP Session Handle In=w19, error in=w18, Number of Samples=w6) -> (USRP Session Handle Out=w21, error out=w22, data=w23)
        Is Equal To 0(x=i2) -> w24
        call "Establish Sub-band.gvi"(Restart Averaging=w24, Frame Parameters=w7, Averaging Parameters=w10, error in=w22, Input Baseband IQ=w23) -> (Power Spectrum averaged Subset=w25, Window Properties=w26, error out=w27, Frame Parameters Out=w28)
        # w24: First Rx for this carrier?
        Logical Or(w27, $"Stop Capture") -> w29
        append w27 to w20
        stop if w29
      }
      Merge Errors(w20) -> (error out=w30)
      Property Node(instance in=w21, error in=w30) -> ("Carrier Frequency"=w31, "LO Frequency"=w32, error out=w33, instance out=w34)
      $"Carrier Freq Out" <- w31
      $"LO Frequency" <- w32
      call "Aggregate Sub-band into Spectrum.gvi"(Frame Parameters=w28, Power Spectrum Subset=w25, Window Properties In=w26, Display=w14, Iteration=i1) -> (Spectrum to Plot=w35, Frame Parameters Out=w36, Spectrum Size=w37)
      call "Plot Spectrum.gvi"(Frame Parameters=w36, Spectrum to Plot In=w35) -> (Spectrum to Plot Out=w38, Frame Parameters out=w39)
      $"FFT Power Spectrum" <- w38
      $"Spectrum Size" <- w37
      next s1 = w32
      stop if w29
    }
    call "Signal Power Detection_2.gvi"(Power Spectrum=w38, threshold=w16, Frame Parameters Out=w39) -> (Power at those Freqs.=w40, Est. Freqs above Thresh=w41, count=w42, sub_band_ind=w43)
    call "Array Fill.gvi"(sub_band_ind=w43, Est. Freqs above Thresh=w41, Count=w42) -> (number elements in array=w44)
    Build Cluster(w41, w40, w42, w44) -> w45
    $"Power Detection" <- w45
    Property Node(instance in=w38) -> ("IQ"=w46)
    call "Waterfal Plot Generator.gvi"(Magnitude=w46, Waterfall History Length=w15) -> (Waterfall Plot=w47)
    $"Waterfall Plot" <- w47
    stop if w29
  }
  call "niUSRP Abort.gvi"(Handle in=w34, error in (no error)=w33) -> (Handle out=w48, Error Out=w49)
  call "niUSRP Close Session.gvi"(handle in=w48, error in=w49) -> (error out=w50)
  $"error out" <- w50
  $"Carrier List" <- w5
  $"Samples per Acquisition" <- w6
  $"Frame Parameters Out" <- w7
