vi "Spectrum Monitor.gvi"   [LabVIEW Communications System Design Software 2.0.1]
panel controls:
  "RX Parameters In": T1 = {"IQ Sampling Rate [S/sec]"=20000000, "Gain [dB]"=0, "Reference Frequency"="Internal", "Timebase Clock Source"="Internal", "Start Carrier [Hz]"=95000000, "Stop Carrier [Hz]"=105000000, "Acq Duration [sec]"=0.0001, "Active Antenna"="RX2"}
  "Device Names": "niUSRPClass" = "192.168.10.2"
  "Averaging Parameters": "Averaging Parameters.gtype" = {"averaging mode"="RMS averaging", "weighting mode"="Linear", "number of averages"=4}  # averaging parameters defines how the averaging is computed. The specifications of the parameters include the type of averaging, the type of weighting, and the number of averages.
  "Display": T4 = {"display unit"="Vrms", "dB type"="dB"}
  "Stop Capture": bool
  "Tab": i32
  "threshold": f64 = -40
  "IQ frac": enum{"0.25", "0.5", "0.6", "0.8"} = "0.25"
  "file path": path
  "Waterall History Length": i32 = 5
panel indicators:
  "error out": error
  "Samples per Acquisition": i64
  "Carrier Freq Out": f64
  "FFT Power Spectrum": cluster{"f0": f64, "df": f64, "IQ": f64[]}
  "LO Frequency": f64
  "Carrier List": f64[]
  "Power Detection": "Power Detection cluster.gtype"
  "2D(freq,ind)": f64[][]
  "signals3D": f64[][][]
  "Waterfall Plot": f64[][]
  "Spectrum Size": i32
  "Frame Parameters Out": T5
  "Signal Data": "Signal Data.gtype"
types:
  T1 = cluster{"IQ Sampling Rate [S/sec]": f64, "Gain [dB]": f64, "Reference Frequency": string, "Timebase Clock Source": string, "Start Carrier [Hz]": f64, "Stop Carrier [Hz]": f64, "Acq Duration [sec]": f64, "Active Antenna": string}
  T2 = enum{"No averaging", "Vector averaging", "RMS averaging", "Peak hold"}
  "Averaging Parameters.gtype" = cluster{"averaging mode": T2, "weighting mode": enum{"Linear", "Exponential"}, "number of averages": u32}
  T3 = enum{"Vrms", "Vpk", "Vrms^2", "Vpk^2", "Vrms/rtHz", "Vpk/rtHz", "Vrms^2/Hz", "Vpk^2/Hz"}
  T4 = cluster{"display unit": T3, "dB type": enum{"Linear", "dB", "dBm"}}
  T5 = cluster{"IQ Rate": f64, "Frames": i32, "Length of Subset": i32, "Start Carrier [Hz": f64, "Stop Carrier [Hz]": f64, "Acq Duration [Sec]": f64, "Start Index of Subset": i32}
  "Power Detection cluster.gtype" = cluster{"Estimated Freqs. above Threshold": f64[], "Power at those Freqs.": f64[], "Num. peaks detected": i32, "Num. in queue": i32}
  "Signal Data.gtype" = cluster{"fc": f64[], "df": f64, "B": u32, "Trigger Save?": bool}
diagram:
  call "niUSRP Open Rx Session.gvi"(niUSRP Device=$"Device Names") -> (error out=w1, session handle out=w2)
  call "Set Parameters.gvi"(RX Parameters In=$"RX Parameters In", USRP Session Handle In=w2, error in (no error)=w1, IQ frac=$"IQ frac") -> (error out: HW RX Param subsetup=w3, USRP Session Handle Out=w4, Test Carrier Frequencies=w5, Samples per Acquisition=w6, Frame Parameters Out=w7, IQ frac out=w8)
  Property Node(instance in=$"Averaging Parameters") -> ("number of averages"=w9, instance out=w10)
  call "niUSRP Configure Number of Samples.gvi"(session handle=w4, number of samples is finite=TRUE, number of samples=w6, error in (no error)=w3) -> (session handle out=w11, Error Out=w12)
  To Long Integer(number=w9) -> w13
  w14 = $"file path"
  w15 = $Display
  w16 = $"Waterall History Length"
  # Testing Spectrum Monitor. Not as many indicators will
  # be on panel in final version.
  s1 = uninitialised  # shift register
  while {
    Is First Call() -> w17
    # Go back to the first carrier frequency and repeat
    s2 = 0  # shift register
    for (iteration -> i1) {
      w18 = each element of w5
      call "Set Carrier and LO_2.gvi"(Current Frequency=w18, niusrp in_2=w11, error in=w12) -> (Error=w19, Usrp.niUSRPClass=w20)
      call "Array Indices for Sub-band.gvi"(First call=w17, error in=w19, 2D(freq,ind)=s1, niusrp in=w20, IQ frac=w8) -> (Local Interests=w21, error out=w22, Usrp.niUSRPClass out=w23)
      # Get new carrier frequency
      for (N = w13) (iteration -> i2) {
        Get Current Time() -> (current time=w26)
        # Averaging Loop
        call "Read Data.gvi"(USRP Session Handle In=w23, error in=w22, Number of Samples=w6) -> (USRP Session Handle Out=w27, error out=w28, data=w29)
        Is Equal To 0(x=i2) -> w30
        call "Establish Sub-band.gvi"(Restart Averaging=w30, Frame Parameters=w7, Averaging Parameters=w10, error in=w28, Input Baseband IQ=w29) -> (Power Spectrum averaged Subset=w31, Window Properties=w32, error out=w33, Frame Parameters Out=w34, power spectrum current=w35)
        call "Gather Signals for Saving.gvi"(Local Interests=w21, power spectrum current=w35, Window Properties=w32) -> (Signal Data=w36, signals2D=w37)
        # w30: First Rx for this carrier?
        Logical Or(w33, $"Stop Capture") -> w38
        append w33 to w24
        append w37 to w25
        stop if w38
      }
      $signals3D <- w25
      call "Save Data to File ALT.gvi"(TimeStamp=w26, file path=w14, Signals3D=w25, Signal Data=w36)
      Merge Errors(w24) -> (error out=w39)
      Property Node(instance in=w27, error in=w39) -> ("Carrier Frequency"=w40, "LO Frequency"=w41, error out=w42, instance out=w43)
      $"Carrier Freq Out" <- w40
      $"Signal Data" <- w36
      $"LO Frequency" <- w41
      call "Aggregate Sub-band into Spectrum.gvi"(Frame Parameters=w34, Power Spectrum Subset=w31, Window Properties In=w32, Display=w15, Iteration=i1) -> (Spectrum to Plot=w44, Frame Parameters Out=w45, Spectrum Size=w46)
      call "Plot Spectrum.gvi"(Frame Parameters=w45, Spectrum to Plot In=w44) -> (Spectrum to Plot Out=w47, Frame Parameters out=w48)
      $"FFT Power Spectrum" <- w47
      $"Spectrum Size" <- w46
      next s2 = w41
      stop if w38
    }
    call "Signal Power Detection_2.gvi"(Power Spectrum=w47, threshold=$threshold, Frame Parameters Out=w48) -> (Power at those Freqs.=w49, Est. Freqs above Thresh=w50, count=w51, sub_band_ind=w52)
    call "Array Fill.gvi"(sub_band_ind=w52, Est. Freqs above Thresh=w50, Count=w51) -> (2D(freq,ind)=w53, number elements in array=w54)
    $"2D(freq,ind)" <- w53
    Build Cluster(w50, w49, w51, w54) -> w55
    $"Power Detection" <- w55
    Property Node(instance in=w47) -> ("IQ"=w56)
    call "Waterfal Plot Generator.gvi"(Magnitude=w56, Waterfall History Length=w16) -> (Waterfall Plot=w57)
    $"Waterfall Plot" <- w57
    next s1 = w53
    stop if w38
  }
  call "niUSRP Abort.gvi"(Handle in=w43, error in (no error)=w42) -> (Handle out=w58, Error Out=w59)
  call "niUSRP Close Session.gvi"(handle in=w58, error in=w59) -> (error out=w60)
  $"error out" <- w60
  $"Carrier List" <- w5
  $"Samples per Acquisition" <- w6
  $"Frame Parameters Out" <- w7
