vi "Aggregate Spectrum.gvi"   [LabVIEW Communications System Design Software 2.0.1]
panel controls:
  "Gain (dB)": f64
  "Device Names": string = "192.168.10.2"
  "Start Frequency": f64
  "End Frequency": f64
  "Interval": f64
  "Active Antenna": string = "RX1"
panel indicators:
  "Error Out": error
  "Coerced Frequency": f64
  "Coerced Gain": f64
  "loop iteration": i32
  "Magnitudes": f64[]
  "f0": f64
  "df": f64
  "power spectrum": T1
  "Graph": f64[]
types:
  T1 = cluster{"f0": f64, "df": f64, "magnitude": f64[]}
uses:
  NI::Analysis::Measurement::Power Spectrum for 1 Chan (CDB).gvi
diagram:
  w1 = $"Device Names"
  w2 = $"Gain (dB)"
  w3 = $"Active Antenna"
  w4 = $"Start Frequency"
  w5 = $"End Frequency"
  w6 = $Interval
  while (iteration -> i1) {
    Math Node("freq_start"=w4, "freq_end"=w5, "interval"=w6, "iter"=i1) -> ("current_carrier_freq"=w7, "iq_rate"=w8, "complete"=w9, "num_samples"=w10)
    ~~~
    current_carrier_freq = freq_start + interval*iter;
    iq_rate = interval;
    num_samples = 200000;

    if (current_carrier_freq < freq_end)
        complete = false;
    else
        complete = true;
    end
    ~~~
    call "niUSRP Open Rx Session.gvi"(niUSRP Device=w1) -> (error out=w11, session handle out=w12)
    call "niUSRP Configure Signal.gvi"(session handle=w12, IQ rate=w8, carrier frequency=w7, gain=w2, error in (no error)=w11, active antenna=w3) -> (session handle out=w13, coerced IQ rate=w14, coerced carrier frequency=w15, coerced gain=w16, Error Out=w17)
    call "niUSRP Initiate.gvi"(session handle=w13, error in (no error)=w17) -> (session handle out=w18, Error Out=w19)
    call "niUSRP Fetch Rx Data (CDB).gvi"(session handle=w18, number of samples=w10, error in (no error)=w19) -> (session handle out=w20, data=w21, Error Out=w22)
    call "niUSRP Abort.gvi"(Handle in=w20, error in (no error)=w22) -> (Handle out=w23, Error Out=w24)
    call "niUSRP Close Session.gvi"(handle in=w23, error in=w24) -> (error out=w25)
    Property Node(instance in=waveform<c128> {dt=1, Y=[]}, "Y"=w21, "dt"=w14) -> (instance out=w26)
    call "Power Spectrum for 1 Chan (CDB).gvi"(signal=w26, dB on=TRUE) -> (power spectrum=w27)
    Property Node(instance in=w27) -> ("f0"=w28, "df"=w29, "magnitude"=w30)
    $f0 <- w28
    $df <- w29
    $"power spectrum" <- w27
    $"Coerced Frequency" <- w15
    $"Coerced Gain" <- w16
    Feedback Node(input=w31) -> w32
    Feedback Node(initial value=0, input=w33) -> w34
    Insert Into Array(inArray=w32, index0=w34, new=w30) -> w31
    $Magnitudes <- w31
    Array Size(array=w31) -> (size(s)=w33)
    $"loop iteration" <- i1
    stop if w9
  }
  $"Error Out" <- w25
