vi "USRP_NI_IQ.gvi"   [LabVIEW Communications System Design Software 2.0.1]
inputs:
  "IVI Refnum In": "niUSRPClass"
  "error in": error
  "Number of Samples": i64
  "Carrier Frequency": f64
  "Active Antenna": string
outputs:
  "IVI Refnum Out": "niUSRPClass"
  "error out": error
  "data": c128[]
diagram:
  case ($"error in") {
    frame No Error, Default {
      Property Node(instance in=$"IVI Refnum In", "Number of Samples Is Finite"=TRUE, "Number of Samples"=$"Number of Samples", "Carrier Frequency"=$"Carrier Frequency", "Active Antenna"=$"Active Antenna", error in=$"error in") -> (error out=w4, instance out=w5)
      call "niUSRP Commit.gvi"(session handle=w5, error in=w4) -> (session handle out=w6, error out=w7)
      call "niUSRP Initiate.gvi"(session handle=w6, error in=w7) -> (session handle out=w8, error out=w9)
      call "niUSRP Fetch Rx Data (CDB).gvi"(session handle=w8, number of samples=$"Number of Samples", error in=w9) -> (session handle out=w10, data=w2, error out=w11)
      call "niUSRP Abort.gvi"(session handle=w10, error in=w11) -> (session handle out=w3, error out=w1)
    }
    frame Error {
      w1 = $"error in"
      w2 = c128[] []
      w3 = $"IVI Refnum In"
    }
  }
  $"IVI Refnum Out" <- w3
  $"error out" <- w1
  $data <- w2
